# Dynamo graph EnergyAnalysisForDynamo_ex1a_SetProjectEnergySettings.dyn (Dynamo 0.7.5.3566)

building_type_dropdown = BuildingTypeDropdown("DiningFamily")
glazing_percentage = DoubleSlider(0.3694050199, range=0..1)
shade_depth = DoubleSlider(0, range=0..3)
skylight_percentage = DoubleSlider(0, range=0..1)
hvac_system_type_dropdown = HVACtypeDropdown("CentralVAVElectricResistanceHeatChillerFivePointNinetySixCOP")
operating_schedules_dropdown = OperatingSchedulesDropdown("DefaultOperatingSchedule")
glazing_percentage_2 = DoubleSlider(0.369, range=0..1)
boolean = BoolSelector(false)
# note: Use this node to Modify Energy Settings Parameters in Project level.
# This setting will be applied to all the zones and surfaces in your model. You can use SetSurfaceParameters and SetZoneParameters to customize the setting for selected zones or surfaces.
setEnergySettings = EnergyAnalysisForDynamo.EnergySettings.SetEnergySettings(building_type_dropdown, glazing_percentage, shade_depth, skylight_percentage, hvac_system_type_dropdown, operating_schedules_dropdown, glazing_percentage_2, boolean)
watch = Watch(setEnergySettings.out0)
watch_2 = Watch(setEnergySettings.out1)
