# Dynamo graph EnergyAnalysisForDynamo_ex2a_DriveSurfacesByOrientation.dyn (Dynamo 0.7.5.3566)

# note: 1. Select Mass element from Revit/Vasari document
select_model_element = DSModelElementSelection()  # 1 picked in the model
# note: 2. Create Analysis Zones from Mass
createByMass = EnergyAnalysisForDynamo.PrepareEnergyModel.CreateByMass(select_model_element)
# note: 3. Get wall surfaces from the list of zones, and compute glazing percentage based on orientation
decomposeZone = EnergyAnalysisForDynamo.PrepareEnergyModel.DecomposeZone(createByMass.out1)
code_block = CodeBlock { -1; }
code_block_2 = CodeBlock { 1; }
YAxis = Vector.YAxis()
analysisSurfaceVector = EnergyAnalysisForDynamo.PrepareEnergyModel.AnalysisSurfaceVector(decomposeZone)
dot = Vector.Dot(YAxis, analysisSurfaceVector)
min_glazing = DoubleSlider(0.2, range=0.2..0.8)
max_glazing = DoubleSlider(0.7463262716, range=0.2..0.8)
mapTo = MapTo(code_block, code_block_2, dot, min_glazing, max_glazing)
code_block_3 = CodeBlock { 1; }
# note: 4.  Set Glazing percentages based on orientation
setWallSurfaceParameters = EnergyAnalysisForDynamo.PrepareEnergyModel.SetWallSurfaceParameters(decomposeZone, mapTo, arg3=code_block_3)
# note: 5. Draw Surfaces in Dynamo
drawAnalysisSurface = EnergyAnalysisForDynamo.PrepareEnergyModel.DrawAnalysisSurface(setWallSurfaceParameters)
watch = Watch(min_glazing)
