# Dynamo graph EnergyAnalysisForDynamo_ex3a_CreategbXMLfromMass.dyn (Dynamo 0.7.5.3566)

file_path = Filename("C:\Users\DReynolds\Desktop\IterativeGlazingTester\test")
# note: 1. Set the file location and name it.
# File extention is not needed
# note: 2. Select Mass from Revit/Vasari document
select_model_element = DSModelElementSelection()  # 1 picked in the model
empty = List.Empty()
# note: 3. Select Mass from Revit/Vasari document for context shading
boolean = BoolSelector(true)
# note: 4. To run an energy analysis you need to compile a gbXML file from a Mass or zones. This node will export a gbXML file for a mass.
exportMassToGBXML = EnergyAnalysisForDynamo.RunAnalysis.ExportMassToGBXML(file_path, select_model_element, empty, boolean)
